# Grasshopper definition Example.gh (Grasshopper 1.0.7)
# plug-ins: Hops

# ---- group: Send Keys
python = GhPythonScript(A=Button(), D=Button(), W=Button(), X=Button(), U=Button(), J=Button(), Q=Button())  # -> out, key
# ---------- python: Python ----------
__author__ = "liors"
__version__ = "2023.01.17"

import rhinoscriptsyntax as rs

if A == True:
    key = "A"
elif D == True:
    key = "D"
elif W == True:
    key = "W"
elif X == True:
    key = "X"
elif U == True:
    key = "U"
elif J == True:
    key = "J"
elif Q == True:
    key = "Q"
else:
    key = 0
# ---------- end python ----------
hops = Hops(
    _Path="http://127.0.0.1:5000/sendKey",
    Key=python.key,
    CacheResultsInMemory=False,
    CacheSolveResults=False,
    RemoteDefinitionLocation="http://127.0.0.1:5000/sendKey",
    RemoteSolveVersion=(0, 1, 0),
    ShowInput_Enabled=False,
    ShowInput_Path=True,
    SynchronousSolve=True)  # disabled
panel = Panel(hops)

# ---- group: Send Frames
pt = ConstructPoint(XCoordinate=Slider(2102, range=0..10000), YCoordinate=Slider(70, range=0..100), ZCoordinate=Slider(2649, range=0..10000))
trigger = Trigger(Interval=100, TimerInterval=100, Target=python_2)  # disabled
vec = VectorXYZ(XComponent=Slider(-48, range=-48..0), YComponent=Slider(-19, range=-19..0), ZComponent=Slider(-158, range=-158..3))  # -> Vector, Length
python_2 = GhPythonScript(Reset=Toggle(True), iPoint=pt)  # -> out, oPoint; inputs iPoint: Point3d
# ---------- python_2: Python ----------
__author__ = "liors"
__version__ = "2023.01.17"

import rhinoscriptsyntax as rs
import Rhino.Geometry as rg

if Reset:
    points = [iPoint]
    
    for i in range(10):
        
        points.append(points[-1]+rg.Vector3d(30,0,0))
        
    counter = 0
    
else:
    if counter < len(points)-1:
        counter += 1
        
oPoint = points[counter]
# ---------- end python_2 ----------
panel_2 = Panel(python_2.oPoint)
hops_2 = Hops(
    _Path="http://127.0.0.1:5000/sendFrame",
    XYZ=python_2.oPoint,
    ABC=vec.Vector,
    CacheResultsInMemory=False,
    CacheSolveResults=False,
    RemoteDefinitionLocation="http://127.0.0.1:5000/sendFrame",
    RemoteSolveVersion=(0, 1, 0),
    ShowInput_Enabled=False,
    ShowInput_Path=True,
    SynchronousSolve=True)  # disabled
panel_3 = Panel(hops_2)

# ---- group: Connect to Server
hops_3 = Hops(
    _Path="http://127.0.0.1:5000/connectClient",
    Connect=Toggle(False),
    CacheResultsInMemory=False,
    CacheSolveResults=False,
    RemoteDefinitionLocation="http://127.0.0.1:5000/connectClient",
    RemoteSolveVersion=(0, 1, 0),
    ShowInput_Enabled=False,
    ShowInput_Path=True,
    SynchronousSolve=True)  # disabled

# ---- group: Create Client
hops_4 = Hops(
    _Path="http://127.0.0.1:5000/createClient",
    IP="192.168.2.1",
    PORT="54600",
    CacheResultsInMemory=False,
    CacheSolveResults=False,
    RemoteDefinitionLocation="http://127.0.0.1:5000/createClient",
    RemoteSolveVersion=(0, 1, 0),
    ShowInput_Enabled=False,
    ShowInput_Path=True,
    SynchronousSolve=True)  # disabled
panel_4 = Panel(hops_4)
